# Grasshopper definition transform_to_origin.gh (Grasshopper 1.0.8)
# Copyright: Arup
# plug-ins: MetaHopper, eleFront

geology_surface_mesh_file_extension = Panel("*.ply")
paraview_meshes_relative_path = Panel("..\data\paraview_meshes")
relative_path = RelativePath(Path=paraview_meshes_relative_path)
file_path = FilePath(relative_path)
text = Text(geology_surface_mesh_file_extension)
query_directory = QueryDirectory(Directory=file_path, Name=text)  # -> graft(Directory), Directories, Files
import_content = ImportContent(FilePath=query_directory.Files)  # -> ModelTransform, Objects, Layers, Linetypes, HatchPatterns, AnnotationStyles, Materials, BlockDefinitions
text_2 = Text(graft(query_directory.Files))
panel = Panel("""\
.""")
text_split = TextSplit(Text=text_2, Separators=panel)
mesh = Mesh(import_content.Objects)
list_item = ListItem(List=text_split, Index=0, Wrap=True)  # -> Item2, Item1, Item
fluvial_deposits_mesh = EleFrontDataDescription(mesh, ShiftDepth=0, isNameSet=True)
mesh_2 = Mesh(flatten(mesh))
suirify = Suirify(list_item.Item2)
bounding_box = BoundingBox(Content=mesh_2, Plane=PlaneXY(0, 0, 0), UnionBox=True)  # -> Box, Box_2
lithology_labels_str = EleFrontDataDescription(suirify, ShiftDepth=0, isNameSet=True)
volume = Volume(Geometry=bounding_box.Box)  # -> Volume, Centroid
deconstruct_box = DeconstructBox(Box=bounding_box.Box)  # -> Plane, X, Y, Z
query_model_layers = QueryModelLayers(Name=lithology_labels_str, AutoUpdateState=True)
model_layer = ModelLayer(graft(query_model_layers))
deconstruct = Deconstruct(Point=volume.Centroid)  # -> XComponent, YComponent, ZComponent
number = Number(deconstruct_box.Z)
suirify_2 = Suirify(model_layer)
construct_point = ConstructPoint(XCoordinate=deconstruct.XComponent, YCoordinate=deconstruct.YComponent, ZCoordinate=number)
construct_point_2 = ConstructPoint(XCoordinate=0, YCoordinate=0, ZCoordinate=0)
model_layer_2 = ModelLayer(Layer=suirify_2)  # -> Layer, Name, Hidden, Locked, DisplayColour, Material, Linetype
vector_2pt = Vector2Pt(PointA=construct_point, PointB=construct_point_2, Unitize=False)  # -> Vector, Length
fluvial_deposits_mesh_2 = EleFrontDataDescription(fluvial_deposits_mesh, ShiftDepth=0, isNameSet=False)
model_material = ModelMaterial(Name=model_layer_2.Name, Shader=model_layer_2.DisplayColour)  # -> Material, Name, Shader
move = Move(Geometry=fluvial_deposits_mesh_2, Motion=vector_2pt.Vector)  # -> Geometry, Transform
render_material = RenderMaterial(Material=model_material.Material)  # -> ObjectMaterial, Source, Material
disjoint_mesh = DisjointMesh(Mesh=move.Geometry)
suirify_3 = Suirify(disjoint_mesh)
render_attributes = RenderAttributes(ObjectMaterial=render_material.ObjectMaterial)  # -> Render, ObjectMaterial, CastsShadows, ReceivesShadows
model_layer_3 = ModelLayer(Layer=model_layer_2.Layer, Material=model_material.Material)  # -> Layer, Name, Hidden, Locked, DisplayColour, Material, Linetype
mesh_3 = Mesh(graft(suirify_3))
combine_clean = CombineClean(Meshes=mesh_3)
model_layer_4 = EleFrontDataDescription(model_layer_3.Layer, ShiftDepth=0, isNameSet=True)
render_attr = EleFrontDataDescription(render_attributes.Render, ShiftDepth=0, isNameSet=True)
name = EleFrontDataDescription(model_layer_3.Name, ShiftDepth=0, isNameSet=False)
trim_tree = TrimTree(Tree=combine_clean, Depth=1)
name_2 = EleFrontDataDescription(name, ShiftDepth=0, isNameSet=False)
model_layer_5 = EleFrontDataDescription(model_layer_4, ShiftDepth=0, isNameSet=False)
render_attr_2 = EleFrontDataDescription(render_attr, ShiftDepth=0, isNameSet=False)

# ---- group: Somme meshes are open => negative volumes
mesh_4 = Mesh(trim_tree)
deconstruct_mesh = DeconstructMesh(Mesh=mesh_4)  # -> Vertices, Faces, Colours, Normals
volume_2 = Volume(Geometry=mesh_4)  # -> Volume, Centroid
list_length = ListLength(List=deconstruct_mesh.Faces)
min_no_mesh_faces = Slider(100, range=50..400)
smaller_than = SmallerThan(FirstNumber=volume_2.Volume, SecondNumber="0")  # -> SmallerThan, OrEqualTo
trim_tree_2 = TrimTree(Tree=list_length, Depth=1)
smaller_than_2 = SmallerThan(FirstNumber=trim_tree_2, SecondNumber=min_no_mesh_faces)  # -> SmallerThan, OrEqualTo
mesh_vol_0__bool = EleFrontDataDescription(smaller_than.SmallerThan, ShiftDepth=0, isNameSet=True)
gate_and = GateAnd(A=smaller_than_2.SmallerThan, B=mesh_vol_0__bool)
boolean = Boolean(invert(gate_and))
cull_pattern = CullPattern(List=mesh_4, CullPattern=boolean)
mesh_5 = Mesh(cull_pattern)

# ----
fluvial_deposits_mesh_3 = EleFrontDataDescription(mesh_5, ShiftDepth=0, isNameSet=True)
fluvial_deposits_mesh_4 = EleFrontDataDescription(fluvial_deposits_mesh_3, ShiftDepth=0, isNameSet=False)
model_layer_6 = EleFrontDataDescription(model_layer_5, ShiftDepth=0, isNameSet=False)
render_attr_3 = EleFrontDataDescription(render_attr_2, ShiftDepth=0, isNameSet=False)
name_3 = EleFrontDataDescription(name_2, ShiftDepth=0, isNameSet=False)
model_object = ModelObject(Geometry=fluvial_deposits_mesh_4, Name=name_3, Layer=model_layer_6, Render=render_attr_3)  # -> Object, Geometry, Name, Layer, Visibility, Display, Drafting, Render
content_cache = ContentCache(Content=model_object.Object)
