# Grasshopper definition site_mesh_to_srf.gh (Grasshopper 1.0.8)
# Copyright: Arup

query_model_objects = QueryModelObjects(Layer="site_mesh", Locked=True, Hidden=True, AutoUpdateState=True)
face_boundaries = FaceBoundaries(Mesh=query_model_objects)
list_item = ListItem(List=face_boundaries, Index=Slider(19, range=0..19), Wrap=True)
boundary_surfaces = BoundarySurfaces(Edges=list_item)
content_cache = ContentCache(Content=boundary_surfaces)
