# Grasshopper definition transform_revit_ecs_to_epsg-p2326-v5738.gh (Grasshopper 1.0.8)
# Copyright: Arup
# plug-ins: eleFront5, Speckle.Connector.Grasshopper

easting = Slider(838809.3, range=838780..838840)
northing = Slider(819822.3, range=819785..819845)
height = Slider(6.6, range=0..10)
rotation = Slider(136, range=0..360)
speckle_model = SpeckleModel(
    Model="55ab2430e5",
    Project="34b188cb10",
    Server="https://app.speckle.systems",
    User="80EEB7BBE4744244BEF9F42A8D144D75",
    Workspace="b6415b8ed6")
speckle_model_2 = SpeckleModel(
    Model="7f2a89be04",
    Project="34b188cb10",
    Server="https://app.speckle.systems",
    User="80EEB7BBE4744244BEF9F42A8D144D75",
    Workspace="b6415b8ed6")
vector_xyz = VectorXYZ(XComponent=easting, YComponent=northing, ZComponent=height)  # -> Vector, Length
radians = Radians(Degrees=rotation)
xy_plane = XYPlane(Origin=Point(0, 0, 0))
load = Load(SpeckleModel=speckle_model, AutoReceive=False)  # -> Collection, Properties
load_2 = Load(SpeckleModel=speckle_model_2, AutoReceive=False)  # -> Collection, Properties
panel = Panel(vector_xyz.Vector)
move = Move(Motion=vector_xyz.Vector)  # -> Geometry, Transform
rotate = Rotate(Angle=radians, Plane=xy_plane)  # -> Geometry, Transform
revit_advanced_sample_arch_spklcollectio = EleFrontDataDescription(load_2.Collection, ShiftDepth=0, isNameSet=True)  # "Revit Advanced Sample Arch_SpklCollection"
revit_advanced_sample_str_spklcollection = EleFrontDataDescription(load.Collection, ShiftDepth=0, isNameSet=True)
merge = Merge(Data1=rotate.Transform, Data2=move.Transform)
point = Point(panel)
compound = Compound(Transforms=merge)
model_object = ModelObject(Geometry=point, Name="epsg2326-5738", Layer="epsg2326-5738")  # -> Object, Geometry, Name, Layer, Visibility, Display, Drafting, Render
collection_selector = CollectionSelector(revit_advanced_sample_str_spklcollection, AutoSelectAllItems=False)
transform = Transform(compound)
revit_ecs_to_epsg_p2326_v5738_transform = EleFrontDataDescription(transform, ShiftDepth=0, isNameSet=True)
content_cache = ContentCache(Content=model_object.Object)
panel_2 = Panel("advanced_sample_project_arch::advanced_sample_project_arch::")
revit_advanced_sample_str_spklcollection_2 = EleFrontDataDescription(revit_advanced_sample_str_spklcollection, ShiftDepth=0, isNameSet=True)
panel_3 = Panel("""Roof
Parapet::Roofs""")
panel_4 = Panel("""No Level
01 - Entry Level
02 - Floor
03 - Floor""")
revit_advanced_sample_arch_spklcollectio_2 = EleFrontDataDescription(revit_advanced_sample_arch_spklcollectio, ShiftDepth=0, isNameSet=False)  # "Revit Advanced Sample Arch_SpklCollection"
concatenate = Concatenate(FragmentA=panel_2, FragmentB=panel_4)
concatenate_2 = Concatenate(FragmentA=panel_2, FragmentB=panel_3)
query_speckle_objects = QuerySpeckleObjects(Collection=revit_advanced_sample_str_spklcollection_2, Path=collection_selector)  # -> Objects, InstanceReference, Points, PointClouds, Curves, Extrusions, Breps, SubDs, Meshes, Hatches
query_speckle_objects_2 = QuerySpeckleObjects(Collection=revit_advanced_sample_arch_spklcollectio_2, Path=concatenate)
query_speckle_objects_3 = QuerySpeckleObjects(Collection=revit_advanced_sample_arch_spklcollectio_2, Path=concatenate_2)
explode_tree = ExplodeTree(Data=query_speckle_objects_2)  # -> Branch0, Branch1, Branch2, Branch3
speckle_data_object = SpeckleDataObject(flatten(query_speckle_objects.Objects))
speckle_data_object_2 = SpeckleDataObject(flatten(query_speckle_objects_3))
_01_entry_level_sdo = EleFrontDataDescription(explode_tree.Branch1, ShiftDepth=0, isNameSet=True)
foundation_sdo = EleFrontDataDescription(speckle_data_object, ShiftDepth=0, isNameSet=True)
_02_floor_sdo = EleFrontDataDescription(explode_tree.Branch2, ShiftDepth=0, isNameSet=True)
_03_floor_sdo = EleFrontDataDescription(explode_tree.Branch3, ShiftDepth=0, isNameSet=True)
no_level_sdo = EleFrontDataDescription(explode_tree.Branch0, ShiftDepth=0, isNameSet=True)
roof_sdo = EleFrontDataDescription(speckle_data_object_2, ShiftDepth=0, isNameSet=True)
speckle_data_object_3 = SpeckleDataObject(SpeckleDataObject=foundation_sdo)  # -> SpeckleDataObject, Geometries, Name, Properties, Path
speckle_data_object_4 = SpeckleDataObject(SpeckleDataObject=no_level_sdo)  # -> SpeckleDataObject, Geometries, Name, Properties, Path
speckle_data_object_5 = SpeckleDataObject(SpeckleDataObject=_01_entry_level_sdo)  # -> SpeckleDataObject, Geometries, Name, Properties, Path
speckle_data_object_6 = SpeckleDataObject(SpeckleDataObject=_02_floor_sdo)  # -> SpeckleDataObject, Geometries, Name, Properties, Path
speckle_data_object_7 = SpeckleDataObject(SpeckleDataObject=_03_floor_sdo)  # -> SpeckleDataObject, Geometries, Name, Properties, Path
speckle_data_object_8 = SpeckleDataObject(SpeckleDataObject=roof_sdo)  # -> SpeckleDataObject, Geometries, Name, Properties, Path
revit_ecs_to_epsg_p2326_v5738_transform_2 = EleFrontDataDescription(revit_ecs_to_epsg_p2326_v5738_transform, ShiftDepth=0, isNameSet=False)
speckle_data_object_9 = SpeckleDataObject(graft(speckle_data_object_3.SpeckleDataObject))
speckle_data_object_10 = SpeckleDataObject(graft(speckle_data_object_4.SpeckleDataObject))
speckle_data_object_11 = SpeckleDataObject(graft(speckle_data_object_5.SpeckleDataObject))
speckle_data_object_12 = SpeckleDataObject(graft(speckle_data_object_6.SpeckleDataObject))
speckle_data_object_13 = SpeckleDataObject(graft(speckle_data_object_7.SpeckleDataObject))
speckle_data_object_14 = SpeckleDataObject(graft(speckle_data_object_8.SpeckleDataObject))
_01_entry_level_sdo_2 = EleFrontDataDescription(speckle_data_object_11, ShiftDepth=0, isNameSet=True)
foundation_sdo_2 = EleFrontDataDescription(speckle_data_object_9, ShiftDepth=0, isNameSet=True)
_02_floor_sdo_2 = EleFrontDataDescription(speckle_data_object_12, ShiftDepth=0, isNameSet=True)
_03_floor_sdo_2 = EleFrontDataDescription(speckle_data_object_13, ShiftDepth=0, isNameSet=True)
no_level_sdo_2 = EleFrontDataDescription(speckle_data_object_10, ShiftDepth=0, isNameSet=True)
roof_sdo_2 = EleFrontDataDescription(speckle_data_object_14, ShiftDepth=0, isNameSet=True)
transform_2 = Transform(Geometry=speckle_data_object_3.Geometries, Transform=revit_ecs_to_epsg_p2326_v5738_transform_2)
transform_3 = Transform(Geometry=speckle_data_object_4.Geometries, Transform=revit_ecs_to_epsg_p2326_v5738_transform_2)
transform_4 = Transform(Geometry=speckle_data_object_5.Geometries, Transform=revit_ecs_to_epsg_p2326_v5738_transform_2)
transform_5 = Transform(Geometry=speckle_data_object_6.Geometries, Transform=revit_ecs_to_epsg_p2326_v5738_transform_2)
transform_6 = Transform(Geometry=speckle_data_object_7.Geometries, Transform=revit_ecs_to_epsg_p2326_v5738_transform_2)
transform_7 = Transform(Geometry=speckle_data_object_8.Geometries, Transform=revit_ecs_to_epsg_p2326_v5738_transform_2)
list_item = ListItem(List=transform_2, Index=0, Wrap=True)  # -> Item, Item1
speckle_data_object_15 = SpeckleDataObject(SpeckleDataObject=foundation_sdo_2, Geometries=transform_2)  # -> SpeckleDataObject, Geometries, Name, Properties, Path
speckle_data_object_16 = SpeckleDataObject(SpeckleDataObject=no_level_sdo_2, Geometries=transform_3)  # -> SpeckleDataObject, Geometries, Name, Properties, Path
speckle_data_object_17 = SpeckleDataObject(SpeckleDataObject=_01_entry_level_sdo_2, Geometries=transform_4)  # -> SpeckleDataObject, Geometries, Name, Properties, Path
speckle_data_object_18 = SpeckleDataObject(SpeckleDataObject=_02_floor_sdo_2, Geometries=transform_5)  # -> SpeckleDataObject, Geometries, Name, Properties, Path
speckle_data_object_19 = SpeckleDataObject(SpeckleDataObject=_03_floor_sdo_2, Geometries=transform_6)  # -> SpeckleDataObject, Geometries, Name, Properties, Path
speckle_data_object_20 = SpeckleDataObject(SpeckleDataObject=roof_sdo_2, Geometries=transform_7)  # -> SpeckleDataObject, Geometries, Name, Properties, Path
item_1 = EleFrontDataDescription(list_item.Item1, ShiftDepth=0, isNameSet=False)
item = EleFrontDataDescription(list_item.Item, ShiftDepth=0, isNameSet=False)
speckle_data_object_21 = SpeckleDataObject(flatten(speckle_data_object_15.SpeckleDataObject))
speckle_data_object_22 = SpeckleDataObject(flatten(speckle_data_object_16.SpeckleDataObject))
speckle_data_object_23 = SpeckleDataObject(flatten(speckle_data_object_17.SpeckleDataObject))
speckle_data_object_24 = SpeckleDataObject(flatten(speckle_data_object_18.SpeckleDataObject))
speckle_data_object_25 = SpeckleDataObject(flatten(speckle_data_object_19.SpeckleDataObject))
speckle_data_object_26 = SpeckleDataObject(flatten(speckle_data_object_20.SpeckleDataObject))
foundation_epsg_p2326_v5738_sdo = EleFrontDataDescription(speckle_data_object_21, ShiftDepth=0, isNameSet=True)
no_level_epsg_p2326_v5738_sdo = EleFrontDataDescription(speckle_data_object_22, ShiftDepth=0, isNameSet=True)
_01_entry_level_epsg_p2326_v5738_sdo = EleFrontDataDescription(speckle_data_object_23, ShiftDepth=0, isNameSet=True)
_02_floor_epsg_p2326_v5738_sdo = EleFrontDataDescription(speckle_data_object_24, ShiftDepth=0, isNameSet=True)
_03_floor_epsg_p2326_v5738_sdo = EleFrontDataDescription(speckle_data_object_25, ShiftDepth=0, isNameSet=True)
roof_epsg_p2326_v5738_sdo = EleFrontDataDescription(speckle_data_object_26, ShiftDepth=0, isNameSet=True)
speckle_model_3 = SpeckleModel(
    Model="721ad7b589",
    Project="dea5d61543",
    Server="https://app.speckle.systems",
    User="80EEB7BBE4744244BEF9F42A8D144D75",
    Workspace="e291c1626c")
create_collection = CreateCollection(
    Foundation=foundation_epsg_p2326_v5738_sdo,
    NoLevel=no_level_epsg_p2326_v5738_sdo,
    _01EntryLevel=_01_entry_level_epsg_p2326_v5738_sdo,
    _02Floor=_02_floor_epsg_p2326_v5738_sdo,
    _03Floor=_03_floor_epsg_p2326_v5738_sdo,
    Roof=roof_epsg_p2326_v5738_sdo,
    AlwaysInheritNames=False)
publish = Publish(SpeckleModel=speckle_model_3, Collection=create_collection)
