# Grasshopper definition geojson_to_rhino_geom.gh (Grasshopper 1.0.8)
# Copyright: Arup
# plug-ins: MetaHopper, eleFront5

site_geojson_path = Panel("..\data\04_feature\cpt_interpreted_rdnap_epsg7415.geojson")
site_geojson_path_2 = Panel("..\data\04_feature\site_plot_rdnap_epsg7415.geojson")
linestring_cylinder_radius_float_m = Slider(0.6, range=0.2..2)
point_sphere_radius_float_m = Slider(1, range=0.2..2)
linestring_cylinder_radius_float_m_2 = EleFrontDataDescription(linestring_cylinder_radius_float_m, ShiftDepth=0, isNameSet=True)
relative_path = RelativePath(Path=site_geojson_path_2)
point_sphere_radius_float_m_2 = EleFrontDataDescription(point_sphere_radius_float_m, ShiftDepth=0, isNameSet=False)
site_elevation_m__float = EleFrontDataDescription(Slider(3, range=0..10), ShiftDepth=0, isNameSet=True)
file_path = FilePath(relative_path)
python_3_script = Python3Script(json_path=file_path)  # -> geometries, property_keys, property_values
# ---------- python_3_script: Python ----------
import json

import ghpythonlib.treehelpers as th
import Rhino.Geometry as rg


def geojson_to_rhino_geometry(geom):
    """Convert a single GeoJSON geometry to Rhino geometry."""
    geom_type = geom["type"]
    coords = geom["coordinates"]

    if geom_type == "Point":
        return rg.Point3d(coords[0], coords[1], coords[2] if len(coords) > 2 else 0)

    elif geom_type == "LineString":
        points = [rg.Point3d(c[0], c[1], c[2] if len(c) > 2 else 0) for c in coords]
        return rg.PolylineCurve(points)

    elif geom_type == "Polygon":
        print(coords)
        # Exterior ring
        exterior = [
            rg.Point3d(c[0], c[1], c[2] if len(c) > 2 else 0) for c in coords[0]
        ]
        exterior_curve = rg.PolylineCurve(exterior)

        # Create planar surface
        breps = rg.Brep.CreatePlanarBreps([exterior_curve], 0.01)
        if not breps:
            return None
        brep = breps[0]

        # Handle holes (interior rings)
        if len(coords) > 1:
            for hole in coords[1:]:
                hole_pts = [
                    rg.Point3d(c[0], c[1], c[2] if len(c) > 2 else 0) for c in hole
                ]
                hole_curve = rg.PolylineCurve(hole_pts)
                hole_brep = rg.Brep.CreatePlanarBreps([hole_curve], 0.01)
                if hole_brep:
                    diff = rg.Brep.CreateBooleanDifference([brep], hole_brep, 0.01)
                    if diff:
                        brep = diff[0]

        return brep

    else:
        return None


with open(json_path, "r") as f:
    geojson = json.load(f)

features = geojson["features"]

geometries = []
property_keys = []
property_values = []
for feat in features:
    geom = feat["geometry"]
    geometries.append([geojson_to_rhino_geometry(geom)])

    properties = feat["properties"]
    property_keys.append(list(properties.keys()))
    property_values.append(list(properties.values()))

geometries = th.list_to_tree(geometries)
property_keys = th.list_to_tree(property_keys)
property_values = th.list_to_tree(property_values)
# ---------- end python_3_script ----------
value_list = ValueList({"AngularDimension", "Arc", "Block", "Brep", "Circle", "Curve", "Dimension", "Ellipse", "Extrusion", "Hatch", "Leader", "Line", "LinearDimension", "Mesh", "Point", "Polyline", "Polysurface", "RadialDimension", "Surface", "Text", "TextDot"}, selected="Point")
geospatial_feature_geometries = EleFrontDataDescription(python_3_script.geometries, ShiftDepth=0, isNameSet=True)
property_values = EleFrontDataDescription(python_3_script.property_values, ShiftDepth=0, isNameSet=False)
property_keys = EleFrontDataDescription(python_3_script.property_keys, ShiftDepth=0, isNameSet=False)
filter_by_type = FilterByType(ObjectType=value_list, Geometry=geospatial_feature_geometries, invertFilter=False, returnNulls=False)  # -> ExcludedGeometry, IncludedGeometry
linestring_cylinder_radius_float_m_3 = EleFrontDataDescription(linestring_cylinder_radius_float_m_2, ShiftDepth=0, isNameSet=False)
value_list_2 = ValueList({"AngularDimension", "Arc", "Block", "Brep", "Circle", "Curve", "Dimension", "Ellipse", "Extrusion", "Hatch", "Leader", "Line", "LinearDimension", "Mesh", "Point", "Polyline", "Polysurface", "RadialDimension", "Surface", "Text", "TextDot"}, selected="Curve")
other_geospatial_geoms = EleFrontDataDescription(filter_by_type.ExcludedGeometry, ShiftDepth=0, isNameSet=True)
property_values_2 = EleFrontDataDescription(property_values, ShiftDepth=0, isNameSet=False)
property_keys_2 = EleFrontDataDescription(property_keys, ShiftDepth=0, isNameSet=False)
point_pt = EleFrontDataDescription(filter_by_type.IncludedGeometry, ShiftDepth=0, isNameSet=True)
point_sphere_radius_float_m_3 = EleFrontDataDescription(point_sphere_radius_float_m_2, ShiftDepth=0, isNameSet=True)
filter_by_type_2 = FilterByType(ObjectType=value_list_2, Geometry=other_geospatial_geoms, invertFilter=False, returnNulls=False)  # -> ExcludedGeometry, IncludedGeometry
point_pt_2 = EleFrontDataDescription(point_pt, ShiftDepth=0, isNameSet=False)
sphere = Sphere(Base=point_pt_2, Radius=point_sphere_radius_float_m_3)
linestring_cylinder_radius_float_m_4 = EleFrontDataDescription(linestring_cylinder_radius_float_m_3, ShiftDepth=0, isNameSet=True)
site_polygon_multi__srf = EleFrontDataDescription(filter_by_type_2.ExcludedGeometry, ShiftDepth=0, isNameSet=True)
point_sphere_srf = EleFrontDataDescription(sphere, ShiftDepth=0, isNameSet=True)
caps_1_flat = Panel("1")
linestring_crv = EleFrontDataDescription(filter_by_type_2.IncludedGeometry, ShiftDepth=0, isNameSet=True)
site_elevation_m__float_2 = EleFrontDataDescription(site_elevation_m__float, ShiftDepth=0, isNameSet=True)
pipe = Pipe(Curve=linestring_crv, Radius=linestring_cylinder_radius_float_m_4, Caps=caps_1_flat)
site_polygon_multi__srf_2 = EleFrontDataDescription(site_polygon_multi__srf, ShiftDepth=0, isNameSet=True)
unit_z = UnitZ(Factor=site_elevation_m__float_2)
linestring_pipe_brep = EleFrontDataDescription(pipe, ShiftDepth=0, isNameSet=True)
point_sphere_srf_2 = EleFrontDataDescription(point_sphere_srf, ShiftDepth=0, isNameSet=False)
property_values_3 = EleFrontDataDescription(property_values_2, ShiftDepth=0, isNameSet=False)
property_keys_3 = EleFrontDataDescription(property_keys_2, ShiftDepth=0, isNameSet=False)
suirify = Suirify(linestring_pipe_brep)
suirify_2 = Suirify(point_sphere_srf_2)
move = Move(Geometry=site_polygon_multi__srf_2, Motion=unit_z)  # -> Geometry, Transform
merge = Merge(Data1=suirify, Data2=suirify_2)
geospatial_meshes__geom = EleFrontDataDescription(merge, ShiftDepth=0, isNameSet=True)
property_values_4 = EleFrontDataDescription(property_values_3, ShiftDepth=0, isNameSet=False)
property_keys_4 = EleFrontDataDescription(property_keys_3, ShiftDepth=0, isNameSet=False)
site_srf = EleFrontDataDescription(move.Geometry, ShiftDepth=0, isNameSet=True)
user_text = UserText(Content=geospatial_meshes__geom, Keys=property_keys_4, Values=property_values_4, UserTextMode=1)  # -> Content, Keys, Values
geospatial_meshes__model_geom = EleFrontDataDescription(user_text.Content, ShiftDepth=0, isNameSet=True)
key = Panel("soil_type")
key_2 = Panel("color")
user_text_2 = UserText(Content=geospatial_meshes__model_geom, Keys=key_2, UserTextMode=1)  # -> Content, Keys, Values
user_text_3 = UserText(Content=geospatial_meshes__model_geom, Keys=key, UserTextMode=1)  # -> Content, Keys, Values
colour = Colour(user_text_2.Values)
borehole_stick_segment_soil_type_str = EleFrontDataDescription(flatten(user_text_3.Values), ShiftDepth=0, isNameSet=True)
borehole_stick_segment_color_str = EleFrontDataDescription(flatten(user_text_2.Values), ShiftDepth=0, isNameSet=True)
borehole_stick_segment_colour = EleFrontDataDescription(colour, ShiftDepth=0, isNameSet=True)
mesh_brep = MeshBrep(
    Brep=user_text_2.Content,
    Settings={GridMaxCount=0, GridMinCount=16, JaggedSeams=False, MaxEdgeLength=0, MinEdgeLength=0.0001, MinTolerance=0, Refine=True, RefineAngle=0, RelativeTolerance=0.65, SimplePlanes=True, Tolerance=0})
custom_preview = CustomPreview(Geometry=mesh_brep, Material=borehole_stick_segment_colour)
create_set = CreateSet(List=borehole_stick_segment_color_str)  # -> Set, Map
create_set_2 = CreateSet(List=borehole_stick_segment_soil_type_str)  # -> Set, Map
colour_2 = Colour(create_set.Set)
model_material = ModelMaterial(Name=create_set_2.Set, Shader=colour_2)  # -> Material, Name, Shader
list_item = ListItem(List=model_material.Material, Index=create_set_2.Map, Wrap=True)
source_1_by_object = Panel("1")
color_hex = Panel("#e77148")
item = EleFrontDataDescription(graft(list_item), ShiftDepth=0, isNameSet=False)
colour_3 = Colour(color_hex)
render_material = RenderMaterial(Source=source_1_by_object, Material=item)  # -> ObjectMaterial, Source, Material
model_material_2 = ModelMaterial(Name="site", Shader=colour_3)  # -> Material, Name, Shader
layer_colour = EleFrontDataDescription(colour_3, ShiftDepth=0, isNameSet=True)
borehole_stick_segment_colour_2 = EleFrontDataDescription(borehole_stick_segment_colour, ShiftDepth=0, isNameSet=False)
site_layer_name_str = EleFrontDataDescription("site", ShiftDepth=0, isNameSet=True)
source_2_by_material = Panel("2")
render_attributes = RenderAttributes(ObjectMaterial=render_material.ObjectMaterial)  # -> Render, ObjectMaterial, CastsShadows, ReceivesShadows
model_layer = ModelLayer(Name=site_layer_name_str, DisplayColour=layer_colour, Material=model_material_2.Material)  # -> Layer, Name, Hidden, Locked, DisplayColour, Material, Linetype
display_colour = DisplayColour(Source=source_2_by_material, Colour=borehole_stick_segment_colour_2)  # -> DisplayColour, Source, Colour
geospatial_meshes__model_geom_2 = EleFrontDataDescription(geospatial_meshes__model_geom, ShiftDepth=0, isNameSet=True)
site_layer_name_str_2 = EleFrontDataDescription(site_layer_name_str, ShiftDepth=0, isNameSet=False)
name = Panel("gi::geology")
site_srf_2 = EleFrontDataDescription(site_srf, ShiftDepth=0, isNameSet=False)
model_object = ModelObject(Geometry=site_srf_2, Name=site_layer_name_str_2, Layer=model_layer.Layer)  # -> Object, Geometry, Name, Layer, Visibility, Display, Drafting, Render
model_object_2 = ModelObject(
    Object=geospatial_meshes__model_geom_2,
    Name=name,
    Layer=name,
    Display=display_colour.DisplayColour,
    Render=render_attributes.Render)  # -> Object, Geometry, Name, Layer, Visibility, Display, Drafting, Render
content_cache = ContentCache(Content=model_object.Object)
content_cache_2 = ContentCache(Content=model_object_2.Object)
