# Grasshopper definition geotop_extends.gh (Grasshopper 1.0.8)
# Copyright: Arup

eastings = Panel("""121900
122000
122100
122200""")
northings = Panel("""488900
488800
488700
488600""")
query_model_objects = QueryModelObjects(Layer="*bgt*", Locked=True, Hidden=True, AutoUpdateState=True)
query_model_objects_2 = QueryModelObjects(Layer="*site*", Locked=True, Hidden=True, AutoUpdateState=True)
number = Number(eastings)
number_2 = Number(northings)
bounding_box = BoundingBox(Content=query_model_objects, Plane=PlaneXY(0, 0, 0), UnionBox=True)  # -> Box, Box_2
cross_reference = CrossReference(ListListA=number, ListListB=number_2, CrossMode=1)  # -> ListListA, ListListB
volume = Volume(Geometry=bounding_box.Box)  # -> Volume, Centroid
area = Area(Geometry=query_model_objects_2)  # -> Area, Centroid
deconstruct_box = DeconstructBox(Box=bounding_box.Box)  # -> Plane, X, Y, Z
construct_point = ConstructPoint(XCoordinate=cross_reference.ListListA, YCoordinate=cross_reference.ListListB, ZCoordinate=0)
panel = Panel(volume.Centroid)
panel_2 = Panel(area.Centroid)
number_3 = Number(deconstruct_box.X)
number_4 = Number(deconstruct_box.Y)
