# Grasshopper definition transform_ecs_proj-crs.gh (Grasshopper 1.0.8)
# Copyright: Arup
# plug-ins: eleFront5, Speckle.Connector.Grasshopper

speckle_model = SpeckleModel(
    Model="f53aed5863",
    Project="d083a8bd5c",
    Server="https://app.speckle.systems",
    User="80EEB7BBE4744244BEF9F42A8D144D75",
    Workspace="0503d870e9")
gi_speckle_model = EleFrontDataDescription(speckle_model, ShiftDepth=0, isNameSet=True)
load = Load(SpeckleModel=gi_speckle_model, AutoReceive=False)  # -> Collection, Properties
collection_selector = CollectionSelector(load.Collection, AutoSelectAllItems=False)
collection_selector_2 = CollectionSelector(load.Collection, AutoSelectAllItems=False)
speckle_collection = SpeckleCollection(load.Collection)
query_speckle_objects = QuerySpeckleObjects(Collection=speckle_collection, Path=collection_selector)
query_speckle_objects_2 = QuerySpeckleObjects(Collection=speckle_collection, Path=collection_selector_2)
speckle_geometry = SpeckleGeometry(flatten(query_speckle_objects_2))
speckle_geometry_2 = SpeckleGeometry(query_speckle_objects)
speckle_geometry_3 = SpeckleGeometry(speckle_geometry)
bounding_box = BoundingBox(Content=speckle_geometry, Plane=PlaneXY(0, 0, 0), UnionBox=True)  # -> Box, Box_2
geology_boreholes_spklgeom = EleFrontDataDescription(speckle_geometry_2, ShiftDepth=0, isNameSet=True)
lithology_gm_spklgeom = EleFrontDataDescription(speckle_geometry_3, ShiftDepth=0, isNameSet=True)
gm_bbox = EleFrontDataDescription(bounding_box.Box, ShiftDepth=0, isNameSet=True)
volume = Volume(Geometry=gm_bbox)  # -> Volume, Centroid
gm_bbox_2 = EleFrontDataDescription(gm_bbox, ShiftDepth=0, isNameSet=False)
bbox_scale = Slider(1.8, range=1..5)
geology_boreholes_spklgeom_2 = EleFrontDataDescription(geology_boreholes_spklgeom, ShiftDepth=0, isNameSet=False)
gm_bbox_centroid_pt = EleFrontDataDescription(volume.Centroid, ShiftDepth=0, isNameSet=True)
gm_bbox_centroid_pt_2 = EleFrontDataDescription(volume.Centroid, ShiftDepth=0, isNameSet=True)
gm_bbox_3 = EleFrontDataDescription(gm_bbox_2, ShiftDepth=0, isNameSet=True)
scale = Scale(Geometry=gm_bbox_3, Center=gm_bbox_centroid_pt, Factor=bbox_scale)  # -> Geometry, Transform
volume_2 = Volume(Geometry=geology_boreholes_spklgeom_2)  # -> Volume, Centroid
geology_boreholes_spklgeom_3 = EleFrontDataDescription(geology_boreholes_spklgeom_2, ShiftDepth=0, isNameSet=False)
point_in_brep = PointInBrep(Brep=scale.Geometry, Point=volume_2.Centroid, Strict=False)
lithology_gm_spklgeom_2 = EleFrontDataDescription(lithology_gm_spklgeom, ShiftDepth=0, isNameSet=False)
cull_pattern = CullPattern(List=geology_boreholes_spklgeom_3, CullPattern=point_in_brep)
entwine = Entwine(Branch00=cull_pattern, Branch01=lithology_gm_spklgeom_2, FlattenInputs=True)
ground_level_elevation_at_mid_point_of_g = Slider(625, range=610..640)  # "Ground level elevation at mid-point of geophysical model"
speckle_geometry_4 = SpeckleGeometry(entwine)
gm_bbox_centroid_pt_3 = EleFrontDataDescription(gm_bbox_centroid_pt_2, ShiftDepth=0, isNameSet=False)
gi_gm_spklegeom = EleFrontDataDescription(speckle_geometry_4, ShiftDepth=0, isNameSet=True)
deconstruct = Deconstruct(Point=gm_bbox_centroid_pt_3)  # -> XComponent, YComponent, ZComponent
gi_gm_spklegeom_2 = EleFrontDataDescription(gi_gm_spklegeom, ShiftDepth=0, isNameSet=False)
construct_point = ConstructPoint(
    XCoordinate=deconstruct.XComponent,
    YCoordinate=deconstruct.YComponent,
    ZCoordinate=ground_level_elevation_at_mid_point_of_g)
construct_point_2 = ConstructPoint(XCoordinate=0, YCoordinate=0, ZCoordinate=0)
model_object = ModelObject(Object=gi_gm_spklegeom_2)  # -> Object, Geometry, Name, Layer, Visibility, Display, Drafting, Render
vector_2pt = Vector2Pt(PointA=construct_point, PointB=construct_point_2, Unitize=False)  # -> Vector, Length
move = Move(Geometry=model_object.Geometry, Motion=vector_2pt.Vector)  # -> Geometry, Transform
gi_gm_spklegeom_3 = EleFrontDataDescription(gi_gm_spklegeom, ShiftDepth=0, isNameSet=True)
speckle_geometry_5 = SpeckleGeometry(SpeckleGeometry=gi_gm_spklegeom_3)  # -> SpeckleGeometry, Geometry, Name, Properties, Color, Material, Path
model_object_2 = ModelObject(Object=model_object.Object, Geometry=move.Geometry)  # -> Object, Geometry, Name, Layer, Visibility, Display, Drafting, Render
speckle_geometry_6 = SpeckleGeometry(SpeckleGeometry=gi_gm_spklegeom_3, Geometry=move.Geometry)  # -> SpeckleGeometry, Geometry, Name, Properties, Color, Material, Path
speckle_geometry_7 = SpeckleGeometry(SpeckleGeometry=gi_gm_spklegeom_3, Geometry=move.Geometry, Properties=speckle_geometry_5.Properties)  # -> SpeckleGeometry, Geometry, Name, Properties, Color, Material, Path
content_cache = ContentCache(Content=model_object_2.Object)
explode_tree = ExplodeTree(Data=speckle_geometry_7.SpeckleGeometry)  # -> Branch0, Branch1
create_collection = CreateCollection(GroundInvestigation=explode_tree.Branch0, GroundModel=explode_tree.Branch1, AlwaysInheritNames=False)
speckle_model_2 = SpeckleModel(Server="https://app.speckle.systems", User="80EEB7BBE4744244BEF9F42A8D144D75", Workspace="0503d870e9")
publish = Publish(SpeckleModel=speckle_model_2, Collection=create_collection)
panel = Panel(publish)
