# Grasshopper definition markthal_geotop_extends.gh (Grasshopper 1.0.8)
# Copyright: Arup
# plug-ins: eleFront5

_3drotterdam_nl_export_center_point_in_e = Panel("93161.94")  # "3drotterdam.nl export center point in EPSG:7415 [m]"
eastings = Panel("""93000
93100
93200
93300""")
northings = Panel("""437300
437400
437500""")
construct_point = ConstructPoint(XCoordinate=_3drotterdam_nl_export_center_point_in_e, YCoordinate="437381.74", ZCoordinate="-9.94")
construct_point_2 = ConstructPoint(XCoordinate=_3drotterdam_nl_export_center_point_in_e, YCoordinate="437381.74", ZCoordinate=0)
number = Number(eastings)
number_2 = Number(northings)
cross_reference = CrossReference(ListListA=number, ListListB=number_2, CrossMode=1)  # -> ListListA, ListListB
xyz_for_3drotterdam_nl_translation = EleFrontDataDescription(construct_point, ShiftDepth=0, isNameSet=True)
xy_for_foundation_translation = EleFrontDataDescription(construct_point_2, ShiftDepth=0, isNameSet=True)
construct_point_3 = ConstructPoint(XCoordinate=cross_reference.ListListA, YCoordinate=cross_reference.ListListB, ZCoordinate=0)
merge = Merge(Data1=xyz_for_3drotterdam_nl_translation, Data2=xy_for_foundation_translation)
model_object = ModelObject(Geometry=merge, Name="epsg7415", Layer="epsg7415")  # -> Object, Geometry, Name, Layer, Visibility, Display, Drafting, Render
content_cache = ContentCache(Content=model_object.Object)
