# Grasshopper definition maastoren_foundation.gh (Grasshopper 1.0.8)
# Copyright: Arup
# plug-ins: eleFront5

mesh = Mesh([<mesh referenced from the Rhino model> x9])
query_model_objects = QueryModelObjects(Layer="Maastoren outline", Locked=True, Hidden=True, AutoUpdateState=True)
query_model_objects_2 = QueryModelObjects(Layer="Pile locations", Locked=True, Hidden=True, AutoUpdateState=True)
mesh_join = MeshJoin(Meshes=mesh)
boundary_surfaces = BoundarySurfaces(Edges=query_model_objects)
point = Point(graft(query_model_objects_2))
area = Area(Geometry=mesh_join)  # -> Area, Centroid
deconstruct = Deconstruct(Point=point)  # -> XComponent, YComponent, ZComponent
paalpuntniveau_m_nap = Panel("-23.5")
user_text = UserText(Content=query_model_objects_2, Keys="PAALBOVENKANT", UserTextMode=1)  # -> Content, Keys, Values
area_2 = Area(Geometry=boundary_surfaces)  # -> Area, Centroid
point_2 = Point(area.Centroid)
content_cache = ContentCache(Content=point_2)
content_cache_2 = ContentCache(Content=area_2.Centroid)
multiplication = Multiplication(A=user_text.Values, B="1000")
multiplication_2 = Multiplication(A="1000", B=paalpuntniveau_m_nap)
model_object = ModelObject(user_text.Content)
construct_point = ConstructPoint(XCoordinate=deconstruct.XComponent, YCoordinate=deconstruct.YComponent, ZCoordinate=multiplication)
construct_point_2 = ConstructPoint(XCoordinate=deconstruct.XComponent, YCoordinate=deconstruct.YComponent, ZCoordinate=multiplication_2)
boorpuntdiameter_mm = Panel("670")
schachtdiameter_mm = Panel("559")
model_object_2 = EleFrontDataDescription(model_object, ShiftDepth=0, isNameSet=False)
line = Line(StartPoint=construct_point, EndPoint=construct_point_2)
multiplication_3 = Multiplication(A=boorpuntdiameter_mm, B="0.5")
user_text_2 = UserText(Content=model_object_2, UserTextMode=1)  # -> Content, Keys, Values
pipe = Pipe(Curve=line, Radius=multiplication_3, Caps="1", FitRail=False)
user_text_3 = UserText(Content=pipe, Keys=user_text_2.Keys, Values=user_text_2.Values, UserTextMode=1)  # -> Content, Keys, Values
model_object_3 = ModelObject(Object=user_text_3.Content, Name="3D foundation", Layer="3D foundation")  # -> Object, Geometry, Name, Layer, Visibility, Display, Drafting, Render
content_cache_3 = ContentCache(Content=model_object_3.Object)
