# Grasshopper definition maastoren_geotop_extends.gh (Grasshopper 1.0.8)
# Copyright: Arup

mesh = Mesh([<mesh referenced from the Rhino model> x2])
bounding_box = BoundingBox(Content=mesh, Plane=PlaneXY(0, 0, 0), UnionBox=True)  # -> Box, Box_2
query_model_objects = QueryModelObjects(Layer="epsg7415", Locked=True, Hidden=True, AutoUpdateState=True)
deconstruct_box = DeconstructBox(Box=bounding_box.Box)  # -> Plane, X, Y, Z
deconstruct = Deconstruct(Point=query_model_objects)  # -> XComponent, YComponent, ZComponent
deconstruct_domain = DeconstructDomain(Domain=deconstruct_box.X)  # -> Start, End
deconstruct_domain_2 = DeconstructDomain(Domain=deconstruct_box.Y)  # -> Start, End
eastings = Panel("""93400
93500
93600""")
northings = Panel("""436000
436100
436200""")
panel = Panel(deconstruct.XComponent)
panel_2 = Panel(deconstruct.YComponent)
number = Number(eastings)
number_2 = Number(northings)
panel_3 = Panel(deconstruct_domain.Start)
panel_4 = Panel(deconstruct_domain.End)
panel_5 = Panel(deconstruct_domain_2.Start)
panel_6 = Panel(deconstruct_domain_2.End)
cross_reference = CrossReference(ListA=number, ListB=number_2, CrossMode=1)  # -> ListA, ListB
subtraction = Subtraction(A=panel_4, B=panel)
subtraction_2 = Subtraction(A=panel_6, B=panel_2)
construct_point = ConstructPoint(XCoordinate=cross_reference.ListA, YCoordinate=cross_reference.ListB, ZCoordinate=0)
