# Grasshopper definition zalmhaven_foundation.gh (Grasshopper 1.0.8)
# Copyright: Arup

query_model_objects = QueryModelObjects(Layer="Nieuwe paal POINTS", Locked=True, Hidden=True, AutoUpdateState=True)
boorpunt_diameter_mm = Panel("950")
buis_diameter_mm = Panel("762")
multiplication = Multiplication(A=boorpunt_diameter_mm, B="0.5")
point = Point(query_model_objects)
afhakhoogte_m_nap = Panel("0.37")
deconstruct = Deconstruct(Point=point)  # -> XComponent, YComponent, ZComponent
paalpuntniveau_m_nap = Panel("-65")
multiplication_2 = Multiplication(A=afhakhoogte_m_nap, B="1000")
multiplication_3 = Multiplication(A="1000", B=paalpuntniveau_m_nap)
construct_point = ConstructPoint(XCoordinate=deconstruct.XComponent, YCoordinate=deconstruct.YComponent, ZCoordinate=multiplication_2)
construct_point_2 = ConstructPoint(XCoordinate=deconstruct.XComponent, YCoordinate=deconstruct.YComponent, ZCoordinate=multiplication_3)
line = Line(StartPoint=construct_point, EndPoint=construct_point_2)
pipe = Pipe(Curve=line, Radius=multiplication, Caps="1", FitRail=False)
content_cache = ContentCache(Content=pipe)
