# Grasshopper definition zalmhaven_geotop_extends.gh (Grasshopper 1.0.8)
# Copyright: Arup
# plug-ins: eleFront5

_3drotterdam_nl_export_center_point_in_e = Panel("92599.6")  # "3drotterdam.nl export center point in EPSG:7415 [m]"
eastings = Panel("""92500
92600
92700""")
northings = Panel("""436100
436200
436300""")
construct_point = ConstructPoint(XCoordinate=_3drotterdam_nl_export_center_point_in_e, YCoordinate="436219.24", ZCoordinate="1.81")
construct_point_2 = ConstructPoint(XCoordinate=_3drotterdam_nl_export_center_point_in_e, YCoordinate="436219.24", ZCoordinate=0)
number = Number(eastings)
number_2 = Number(northings)
cross_reference = CrossReference(ListListA=number, ListListB=number_2, CrossMode=1)  # -> ListListA, ListListB
xyz_for_3drotterdam_nl_translation = EleFrontDataDescription(construct_point, ShiftDepth=0, isNameSet=True)
xy_for_foundation_translation = EleFrontDataDescription(construct_point_2, ShiftDepth=0, isNameSet=True)
construct_point_3 = ConstructPoint(XCoordinate=cross_reference.ListListA, YCoordinate=cross_reference.ListListB, ZCoordinate=0)
merge = Merge(Data1=xyz_for_3drotterdam_nl_translation, Data2=xy_for_foundation_translation)
model_object = ModelObject(Geometry=merge, Name="epsg7415", Layer="epsg7415")  # -> Object, Geometry, Name, Layer, Visibility, Display, Drafting, Render
content_cache = ContentCache(Content=model_object.Object)
