# Grasshopper definition get_demo_models.gh (Grasshopper 1.0.8)
# plug-ins: eleFront5, Speckle.Connector.Grasshopper

speckle_demo_models_project_url = Panel("https://app.speckle.systems/projects/8be1007be1")
rhino_clubhouse_interiors_furniture_roof = Panel("""87f3ba9541
1c72499f69
cc878fae03
de46f47fc2
478d7a4664""")  # "rhino/clubhouse/interiors, furniture, roof, str, facade"
parent_parent = Panel("../../")
speckle_model = ValueList({"interiors": 0, "furniture": 1, "roof": 2, "structure": 3, "facade": 4}, selected="structure")
query_directory = QueryDirectory(Directory=parent_parent)  # -> graft(Directory), Directories, Files
concatenate = Concatenate(Speckle_Project_URL=speckle_demo_models_project_url, A="/models/", Model_ID=rhino_clubhouse_interiors_furniture_roof)
selected_speckle_model_int = EleFrontDataDescription(speckle_model, ShiftDepth=0, isNameSet=True)
concatenate_2 = Concatenate(FragmentA=query_directory.Directory, FragmentB=".env")
speckle_model_urls = EleFrontDataDescription(concatenate, ShiftDepth=0, isNameSet=True)
read_file = ReadFile(File=concatenate_2, PerLineParse=True)
list_item = ListItem(List=speckle_model_urls, Index=selected_speckle_model_int, Wrap=True)
match_text = MatchText(Text=read_file, RegEx="SPECKLE_ACCESS_TOKEN", Case=True)
speckle_model_url = Panel(list_item)
cull_pattern = CullPattern(List=read_file, CullPattern=match_text)
text_split = TextSplit(Text=cull_pattern, Separators="=")
list_item_2 = ListItem(List=text_split, Index=0, Wrap=True)  # -> Item, Item1
speckle_access_token = EleFrontDataDescription(list_item_2.Item1, ShiftDepth=0, isNameSet=True)
speckle_model_url_2 = EleFrontDataDescription(speckle_model_url, ShiftDepth=0, isNameSet=True)
speckle_model_url_with_token = SpeckleModelURLWithToken(SpeckleUrl=speckle_model_url_2, SpeckleToken=speckle_access_token)
load = Load(SpeckleModel=speckle_model_url_with_token, AutoReceive=False)  # -> Collection, Properties
